# Grasshopper definition parametricBucketCupConetrunk.gh (Grasshopper 1.0.8)
# Copyright: MIT License vicdlsns / vdl149

# - All units are the same as your Rhino settings
# - Use sliders to set the dimensions as you wish
# - When finished, click on the "geo" component at the end, right-click it, then "Bake" and "Ok"
# Copyright (c) 2025 vicdlsns/vdl149
# MIT License
# https://github.com/vicdlsns
bottomdiameter = Slider(60, range=10..90)
materialthickness = Slider(3, range=1..10)
topdiameter = Slider(120, range=10..210)
height = Slider(80, range=10..90)
cluster = Cluster(bottomdiameter=bottomdiameter, topdiameter=topdiameter, materialthickness=materialthickness, height=height)
geo = Geometry(cluster)

# ==== cluster Cluster
bottomdiameter = ClusterInput()
materialthickness = ClusterInput()
topdiameter = ClusterInput()
height = ClusterInput()

bottomdiameter_2 = Number(bottomdiameter)
materialthickness_2 = Number(materialthickness)
topdiameter_2 = Number(topdiameter)
height_2 = Number(height)

division = Division(A=topdiameter_2, B=2)
division_2 = Division(A=bottomdiameter_2, B=2)

# ----
# Bottom
# In
# Out
pt = ConstructPoint(XCoordinate=0, YCoordinate=0, ZCoordinate=0)
Z = UnitZ(Factor=materialthickness_2)
circle = CircleCNR(Center=pt, Normal=Vector(0, 0, 1), Radius=division_2)
offset = OffsetCurve(Curve=circle, Distance=materialthickness_2, Corners=1)
move = Move(Geometry=circle, Motion=Z)  # -> Geometry, Transform

# ----
# Top
# In
# Out
Z_2 = UnitZ(Factor=height_2)
circle_2 = CircleCNR(Center=Z_2, Normal=Vector(0, 0, 1), Radius=division)
offset_2 = OffsetCurve(Curve=circle_2, Distance=materialthickness_2, Corners=1)

# ----
# Outside
loft = Loft(
    Curves=[offset, offset_2],
    Options={Adjust=False, Closed=False, LoftEnds=0, LoftSimp=0, LoftType=0, Rebuild=10, Refit=0.01})
cap = CapHoles(Brep=loft)

# ----
# Inside
loft_2 = Loft(
    Curves=[move.Geometry, circle_2],
    Options={Adjust=False, Closed=False, LoftEnds=0, LoftSimp=0, LoftType=0, Rebuild=10, Refit=0.01})
cap_2 = CapHoles(Brep=loft_2)

sdiff = SolidDifference(BrepsA=cap, BrepsB=cap_2)

R = ClusterOutput(sdiff)
