# Grasshopper definition parametricCoasterHolder.gh (Grasshopper 1.0.8)
# Copyright: MIT License vicdlsns / vdl149

materialthickness = Slider(3, range=0..10)
# - All units are the same as your Rhino settings
# - Use sliders to set the dimensions as you wish
# - When finished, click on the "geo" component at the end, right-click it, then "Bake" and "Ok"
# Copyright (c) 2025 vicdlsns/vdl149
# MIT License
# https://github.com/vicdlsns
insidediameter = Slider(90, range=10..100)
height = Slider(30, range=10..50)
holewidth = Slider(15, range=10..50)
cluster = Cluster(
    insidediameter=insidediameter,
    thickness=materialthickness,
    height=height,
    holewidth=holewidth,
    numholes=Slider(4, range=1..4))
geo = Geometry(cluster)

# ==== cluster Cluster
numholes = ClusterInput()
holewidth = ClusterInput()
height = ClusterInput()
insidediameter = ClusterInput()
thickness = ClusterInput()

numholes_2 = Number(numholes)
holewidth_2 = Number(holewidth)
height_2 = Number(height)
insidediameter_2 = Number(insidediameter)
thickness_2 = Number(thickness)

division = Division(A=insidediameter_2, B=2)

# ----
# Base
pt = ConstructPoint(XCoordinate=0, YCoordinate=0, ZCoordinate=0)
circle = CircleCNR(Center=pt, Normal=Vector(0, 0, 1), Radius=division)
boundary = BoundarySurfaces(Edges=flatten(circle))
Z = UnitZ(Factor=thickness_2)
extr = Extrude(Base=boundary, Direction=Z)

# ----
# Holes
pt_2 = ConstructPoint(XCoordinate=0, YCoordinate=0, ZCoordinate=height_2)
subtraction = Subtraction(A=height_2, B=thickness_2)
yz = YZPlane(Origin=pt_2)
ellipse = Ellipse(Plane=yz, Radius1=holewidth_2, Radius2=subtraction)  # -> Ellipse, Focus1, Focus2
addition = Addition(A=division, B=thickness_2)
boundary_2 = BoundarySurfaces(Edges=ellipse.Ellipse)
X = UnitX(Factor=addition)
extr_2 = Extrude(Base=boundary_2, Direction=X)
arrpolar = PolarArray(Geometry=extr_2, Plane=PlaneXY(0, 0, 0), Count=numholes_2, Angle=6.283185307)  # -> Geometry, Transform

# ----
# Border
offset = OffsetCurve(Curve=circle, Distance=thickness_2, Corners=1)
boundary_3 = BoundarySurfaces(Edges=flatten([circle, offset]))
Z_2 = UnitZ(Factor=height_2)
extr_3 = Extrude(Base=boundary_3, Direction=Z_2)

sunion = SolidUnion(Breps=[extr, extr_3])

sdiff = SolidDifference(BrepsA=sunion, BrepsB=arrpolar.Geometry)

R = ClusterOutput(sdiff)
