# Grasshopper definition parametricCupholder.gh (Grasshopper 1.0.8)

handleheight = Slider(55, range=0..100)
screwholeheight = Slider(40, range=0..100)
handlewidth = Slider(55, range=0..100)
handledistancering = Slider(10, range=1..100)
handledepth = Slider(5, range=0..100)
screwholediameter = Slider(7, range=0..10)
filletradius = Slider(10, range=0..30)

basedistance = Slider(90, range=0..250)
basewidth = Slider(5, range=0..10)
usebase = BooleanToggle(False)

ringheight = Slider(20, range=0..100)
innerdiameter = Slider(80, range=0..100)
outerdiameter = Slider(85, range=0..100)

division = Division(A=innerdiameter, B=2)
cyl = Cylinder(Base=PlaneXY(0, 0, 0), Radius=division, Length=ringheight)
cap = CapHoles(Brep=cyl)

# ----
# Auxiliar box
subtraction = Subtraction(A=outerdiameter, B=innerdiameter)
division_2 = Division(A=handlewidth, B=2)
division_3 = Division(A=ringheight, B=2)
division_4 = Division(A=subtraction, B=2)
box = CenterBox(Base=PlaneXY(0, 0, 0), X=subtraction, Y=division_2, Z=division_3)
subtraction_2 = Subtraction(A=division, B=division_4)
Z = UnitZ(Factor=division_3)
X = UnitX(Factor=subtraction_2)
move = Move(Geometry=box, Motion=Z)  # -> Geometry, Transform
move_2 = Move(Geometry=move.Geometry, Motion=X)  # -> Geometry, Transform
debrep = DeconstructBrep(Brep=move_2.Geometry)  # -> Faces, Edges, Vertices

division_5 = Division(A=outerdiameter, B=2)
cyl_2 = Cylinder(Base=PlaneXY(0, 0, 0), Radius=division_5, Length=ringheight)
cap_2 = CapHoles(Brep=cyl_2)

# ----
# Screw hole
division_6 = Division(A=screwholediameter, B=2)
cyl_3 = Cylinder(Base=PlaneXY(0, 0, 0), Radius=division_6, Length=handledepth)
addition = Addition(A=ringheight, B=screwholeheight)
cap_3 = CapHoles(Brep=cyl_3)
addition_2 = Addition(A=division_5, B=handledepth, C=handledistancering)
rotate = RotateDirection(Geometry=cap_3, Center=Point(0, 0, 0), From=Vector(1, 0, 0), To=Vector(0, 0, 19.03875613))  # -> Geometry, Transform
X_2 = UnitX(Factor=addition_2)
Z_2 = UnitZ(Factor=addition)
addition_3 = Addition(A=X_2, B=Z_2)
move_3 = Move(Geometry=rotate.Geometry, Motion=addition_3)  # -> Geometry, Transform

# ----
# Ring
sdiff = SolidDifference(BrepsA=cap_2, BrepsB=cap)

item = ListItem(List=debrep.Faces, Index=1, Wrap=True)
X_3 = UnitX(Factor=handledistancering)
extr = Extrude(Base=item, Direction=X_3)

debrep_2 = DeconstructBrep(Brep=extr)  # -> Faces, Edges, Vertices
item_2 = ListItem(List=debrep_2.Faces, Index=5, Wrap=True)
X_4 = UnitX(Factor=handledepth)
extr_2 = Extrude(Base=item_2, Direction=X_4)

Z_3 = UnitZ(Factor=handleheight)
debrep_3 = DeconstructBrep(Brep=extr_2)  # -> Faces, Edges, Vertices
item_3 = ListItem(List=debrep_3.Faces, Index=2, Wrap=True)
extr_3 = Extrude(Base=item_3, Direction=Z_3)
filedge = FilletEdge(Shape=extr_3, Blend=0, Metric=0, Edges=[6, 11], Radii=filletradius)

cyl_4 = Cylinder(Base=PlaneXY(0, 0, 0), Radius=division_5, Length=basewidth)
Z_4 = UnitZ(Factor=expr("-x", basedistance))
cap_4 = CapHoles(Brep=cyl_4)
move_4 = Move(Geometry=cap_4, Motion=Z_4)  # -> Geometry, Transform

sdiff_2 = SolidDifference(BrepsA=move_2.Geometry, BrepsB=cap)

debrep_4 = DeconstructBrep(Brep=sdiff_2)  # -> Faces, Edges, Vertices
item_4 = ListItem(List=debrep_4.Faces, Index=4, Wrap=True)
Z_5 = UnitZ(Factor=expr("-x", basedistance))
addition_4 = Addition(A=handledistancering, B=handledepth)
extr_4 = Extrude(Base=item_4, Direction=Z_5)
X_5 = UnitX(Factor=addition_4)
debrep_5 = DeconstructBrep(Brep=extr_4)  # -> Faces, Edges, Vertices
item_5 = ListItem(List=debrep_5.Faces, Index=3, Wrap=True)
extr_5 = Extrude(Base=item_5, Direction=X_5)

# ----
# Handle
geo = Geometry([sdiff_2, extr, extr_2, filedge])

# ----
# Base
geo_2 = Geometry([move_4.Geometry, extr_4, extr_5])
filter = StreamFilter(Gate=usebase, Stream1=geo_2)  # -> flatten(Stream)

sunion = SolidUnion(Breps=flatten([geo, sdiff, filter]))
sdiff_3 = SolidDifference(BrepsA=sunion, BrepsB=move_3.Geometry)

geo_3 = Geometry(sdiff_3)
