# Grasshopper definition parametricCupholderScrew.gh (Grasshopper 1.0.8)

# ----
# Handle
handleheight = Slider(55, range=0..100)
screwholeheight = Slider(40, range=0..100)
handlewidth = Slider(55, range=0..100)
handledistancering = Slider(10, range=1..100)
handledepth = Slider(5, range=0..100)
screwholediameter = Slider(7, range=0..10)
filletradius = Slider(10, range=0..30)

# ----
# Base
basedistance = Slider(90, range=0..250)
basewidth = Slider(5, range=0..10)
usebase = BooleanToggle(False)

# ----
# Ring
ringheight = Slider(20, range=0..100)
innerdiameter = Slider(80, range=0..100)
# - All units are the same as your Rhino settings
# - Use sliders to set the dimensions as you wish
# - When finished, click on the "geo" component at the end, right-click it, then "Bake" and "Ok"
# Copyright (c) 2025 vicdlsns/vdl149
# MIT License
# https://github.com/vicdlsns
outerdiameter = Slider(85, range=0..100)

parametric_cupholder = ParametricCupholder(
    outerdiameter=outerdiameter,
    innerdiameter=innerdiameter,
    ringheight=ringheight,
    handlewidth=handlewidth,
    handledistancering=handledistancering,
    handledepth=handledepth,
    handleheight=handleheight,
    filletradius=filletradius,
    screwholediameter=screwholediameter,
    screwholeheight=screwholeheight,
    usebase=usebase,
    basewidth=basewidth,
    basedistance=basedistance)
geo = Geometry(parametric_cupholder)

# ==== cluster ParametricCupholder
usebase = ClusterInput()
basewidth = ClusterInput()
basedistance = ClusterInput()
handledistancering = ClusterInput()
handlewidth = ClusterInput()
screwholediameter = ClusterInput()
screwholeheight = ClusterInput()
handleheight = ClusterInput()
filletradius = ClusterInput()

usebase_2 = Boolean(usebase)
basewidth_2 = Number(basewidth)
basedistance_2 = Number(basedistance)

handledepth = ClusterInput()

handledistancering_2 = Number(handledistancering)
handlewidth_2 = Number(handlewidth)
screwholediameter_2 = Number(screwholediameter)
screwholeheight_2 = Number(screwholeheight)
handleheight_2 = Number(handleheight)
filletradius_2 = Number(filletradius)
handledepth_2 = Number(handledepth)

outerdiameter = ClusterInput()
ringheight = ClusterInput()
innerdiameter = ClusterInput()

outerdiameter_2 = Number(outerdiameter)
ringheight_2 = Number(ringheight)
innerdiameter_2 = Number(innerdiameter)

division = Division(A=innerdiameter_2, B=2)
cyl = Cylinder(Base=PlaneXY(0, 0, 0), Radius=division, Length=ringheight_2)
cap = CapHoles(Brep=cyl)

division_2 = Division(A=outerdiameter_2, B=2)
cyl_2 = Cylinder(Base=PlaneXY(0, 0, 0), Radius=division_2, Length=ringheight_2)
cap_2 = CapHoles(Brep=cyl_2)

# ----
# Screw hole
division_3 = Division(A=screwholediameter_2, B=2)
cyl_3 = Cylinder(Base=PlaneXY(0, 0, 0), Radius=division_3, Length=handledepth_2)
addition = Addition(A=ringheight_2, B=screwholeheight_2)
cap_3 = CapHoles(Brep=cyl_3)
addition_2 = Addition(A=division_2, B=handledepth_2, C=handledistancering_2)
rotate = RotateDirection(Geometry=cap_3, Center=Point(0, 0, 0), From=Vector(1, 0, 0), To=Vector(0, 0, 19.03875613))  # -> Geometry, Transform
X = UnitX(Factor=addition_2)
Z = UnitZ(Factor=addition)
addition_3 = Addition(A=X, B=Z)
move = Move(Geometry=rotate.Geometry, Motion=addition_3)  # -> Geometry, Transform

# ----
# Ring
sdiff = SolidDifference(BrepsA=cap_2, BrepsB=cap)

cyl_4 = Cylinder(Base=PlaneXY(0, 0, 0), Radius=division_2, Length=basewidth_2)
Z_2 = UnitZ(Factor=expr("-x", basedistance_2))
cap_4 = CapHoles(Brep=cyl_4)
move_2 = Move(Geometry=cap_4, Motion=Z_2)  # -> Geometry, Transform

# ----
# Auxiliar box
subtraction = Subtraction(A=outerdiameter_2, B=innerdiameter_2)
division_4 = Division(A=handlewidth_2, B=2)
division_5 = Division(A=ringheight_2, B=2)
division_6 = Division(A=subtraction, B=2)
box = CenterBox(Base=PlaneXY(0, 0, 0), X=division_2, Y=division_4, Z=division_5)
Z_3 = UnitZ(Factor=division_5)
move_3 = Move(Geometry=box, Motion=Z_3)  # -> Geometry, Transform

subtraction_2 = Subtraction(A=0, B=division_6)

subtraction_3 = Subtraction(A=division, B=division, C=subtraction_2)
X_2 = UnitX(Factor=subtraction_3)
move_4 = Move(Geometry=move_3.Geometry, Motion=X_2)  # -> Geometry, Transform
debrep = DeconstructBrep(Brep=move_4.Geometry)  # -> Faces, Edges, Vertices

item = ListItem(List=debrep.Faces, Index=1, Wrap=True)
X_3 = UnitX(Factor=handledistancering_2)
extr = Extrude(Base=item, Direction=X_3)

debrep_2 = DeconstructBrep(Brep=extr)  # -> Faces, Edges, Vertices
item_2 = ListItem(List=debrep_2.Faces, Index=5, Wrap=True)
X_4 = UnitX(Factor=handledepth_2)
extr_2 = Extrude(Base=item_2, Direction=X_4)

Z_4 = UnitZ(Factor=handleheight_2)
debrep_3 = DeconstructBrep(Brep=extr_2)  # -> Faces, Edges, Vertices
item_3 = ListItem(List=debrep_3.Faces, Index=2, Wrap=True)
extr_3 = Extrude(Base=item_3, Direction=Z_4)
filedge = FilletEdge(Shape=extr_3, Blend=0, Metric=0, Edges=[6, 11], Radii=filletradius_2)

sdiff_2 = SolidDifference(BrepsA=move_4.Geometry, BrepsB=cap)

debrep_4 = DeconstructBrep(Brep=sdiff_2)  # -> Faces, Edges, Vertices
item_4 = ListItem(List=debrep_4.Faces, Index=4, Wrap=True)
Z_5 = UnitZ(Factor=expr("-x", basedistance_2))
addition_4 = Addition(A=handledistancering_2, B=handledepth_2)
extr_4 = Extrude(Base=item_4, Direction=Z_5)
X_5 = UnitX(Factor=addition_4)
debrep_5 = DeconstructBrep(Brep=extr_4)  # -> Faces, Edges, Vertices
item_5 = ListItem(List=debrep_5.Faces, Index=3, Wrap=True)
extr_5 = Extrude(Base=item_5, Direction=X_5)

# ----
# Handle
geo = Geometry([sdiff_2, extr, filedge, extr_2])

# ----
# Base
geo_2 = Geometry([move_2.Geometry, extr_4, extr_5])
filter = StreamFilter(Gate=usebase_2, Stream1=geo_2)  # -> flatten(Stream)

sunion = SolidUnion(Breps=flatten([geo, sdiff, filter]))
sdiff_3 = SolidDifference(BrepsA=sunion, BrepsB=move.Geometry)

R = ClusterOutput(sdiff_3)
