# Grasshopper definition parametricRectHolderScrew.gh (Grasshopper 1.0.8)
# Copyright: MIT License vicdlsns / vdl149

# ----
# Handle
handleheight = Slider(55, range=0..100)
screwholeheight = Slider(40, range=0..100)
handlewidth = Slider(55, range=0..100)
handledistancering = Slider(10, range=1..100)
handledepth = Slider(5, range=0..100)
screwholediameter = Slider(7, range=0..10)
filletradius = Slider(10, range=0..30)

# ----
# Base
basedistance = Slider(78, range=0..250)
basewidth = Slider(5, range=0..10)

# ----
# Ring
ringheight = Slider(20, range=0..100)
ringthickness = Slider(5, range=0..10)
outerwidth = Slider(100, range=0..100)
# - All units are the same as your Rhino settings
# - Use sliders to set the dimensions as you wish
# - When finished, click on the "geo" component at the end, right-click it, then "Bake" and "Ok"
# Copyright (c) 2025 vicdlsns/vdl149
# MIT License
# https://github.com/vicdlsns
outerlength = Slider(100, range=0..100)

cluster = Cluster(
    outerlength=outerlength,
    outerwidth=outerwidth,
    ringthickness=ringthickness,
    ringheight=ringheight,
    handlewidth=handlewidth,
    handledistancering=handledistancering,
    handledepth=handledepth,
    handleheight=handleheight,
    filletradius=filletradius,
    screwholediameter=screwholediameter,
    screwholeheight=screwholeheight,
    basewidth=basewidth,
    basedistance=basedistance)
geo = Geometry(cluster)

# ==== cluster Cluster
basewidth = ClusterInput()
basedistance = ClusterInput()
handledistancering = ClusterInput()
handlewidth = ClusterInput()
screwholediameter = ClusterInput()
screwholeheight = ClusterInput()
handleheight = ClusterInput()
filletradius = ClusterInput()
handledepth = ClusterInput()

basewidth_2 = Number(basewidth)
basedistance_2 = Number(basedistance)

handledistancering_2 = Number(handledistancering)
handlewidth_2 = Number(handlewidth)
screwholediameter_2 = Number(screwholediameter)
screwholeheight_2 = Number(screwholeheight)
handleheight_2 = Number(handleheight)
filletradius_2 = Number(filletradius)
handledepth_2 = Number(handledepth)

outerlength = ClusterInput()
ringheight = ClusterInput()
ringthickness = ClusterInput()
outerwidth = ClusterInput()

outerlength_2 = Number(outerlength)
ringheight_2 = Number(ringheight)
ringthickness_2 = Number(ringthickness)
outerwidth_2 = Number(outerwidth)

# ----
# Ring
division = Division(A=outerlength_2, B=2)
division_2 = Division(A=outerwidth_2, B=2)
subtraction = Subtraction(A=division_2, B=ringthickness_2)
division_3 = Division(A=ringheight_2, B=2)
subtraction_2 = Subtraction(A=division, B=ringthickness_2)
box = CenterBox(Base=PlaneXY(0, 0, 0), X=subtraction_2, Y=subtraction, Z=division_3)
box_2 = CenterBox(Base=PlaneXY(0, 0, 0), X=division, Y=division_2, Z=division_3)
sdiff = SolidDifference(BrepsA=box_2, BrepsB=box)
Z = UnitZ(Factor=division_3)
move = Move(Geometry=sdiff, Motion=Z)  # -> Geometry, Transform

# ----
# Auxiliar box
division_4 = Division(A=handledistancering_2, B=2)
division_5 = Division(A=handlewidth_2, B=2)
box_3 = CenterBox(Base=PlaneXY(0, 0, 0), X=division_4, Y=division_5, Z=division_3)
Z_2 = UnitZ(Factor=division_3)
move_2 = Move(Geometry=box_3, Motion=Z_2)  # -> Geometry, Transform
addition = Addition(A=division, B=division_4)
X = UnitX(Factor=addition)
move_3 = Move(Geometry=move_2.Geometry, Motion=X)  # -> Geometry, Transform

# ----
# Screw hole
division_6 = Division(A=screwholediameter_2, B=2)
cyl = Cylinder(Base=PlaneXY(0, 0, 0), Radius=division_6, Length=handledepth_2)
addition_2 = Addition(A=ringheight_2, B=screwholeheight_2)
cap = CapHoles(Brep=cyl)
addition_3 = Addition(A=division, B=handledepth_2, C=handledistancering_2)
rotate = RotateDirection(Geometry=cap, Center=Point(0, 0, 0), From=Vector(1, 0, 0), To=Vector(0, 0, 19.03875613))  # -> Geometry, Transform
X_2 = UnitX(Factor=addition_3)
Z_3 = UnitZ(Factor=addition_2)
addition_4 = Addition(A=X_2, B=Z_3)
move_4 = Move(Geometry=rotate.Geometry, Motion=addition_4)  # -> Geometry, Transform

debrep = DeconstructBrep(Brep=move_3.Geometry)  # -> Faces, Edges, Vertices

# ----
# Handle
Z_4 = UnitZ(Factor=handleheight_2)
item = ListItem(List=debrep.Faces, Index=1, Wrap=True)
X_3 = UnitX(Factor=handledepth_2)
extr = Extrude(Base=item, Direction=X_3)
debrep_2 = DeconstructBrep(Brep=extr)  # -> Faces, Edges, Vertices
item_2 = ListItem(List=debrep_2.Faces, Index=2, Wrap=True)
extr_2 = Extrude(Base=item_2, Direction=Z_4)
filedge = FilletEdge(Shape=extr_2, Blend=0, Metric=0, Edges=[6, 11], Radii=filletradius_2)
geo = Geometry([filedge, extr])

division_7 = Division(A=basewidth_2, B=2)
subtraction_3 = Subtraction(A=basedistance_2, B=division_7)
box_4 = CenterBox(Base=PlaneXY(0, 0, 0), X=division, Y=division_2, Z=division_7)
Z_5 = UnitZ(Factor=expr("-x", subtraction_3))

# ----
# Base
item_3 = ListItem(List=debrep.Faces, Index=4, Wrap=True)
Z_6 = UnitZ(Factor=expr("-x", basedistance_2))
extr_3 = Extrude(Base=item_3, Direction=Z_6)
move_5 = Move(Geometry=box_4, Motion=Z_5)  # -> Geometry, Transform
X_4 = UnitX(Factor=handledepth_2)
debrep_3 = DeconstructBrep(Brep=extr_3)  # -> Faces, Edges, Vertices
item_4 = ListItem(List=debrep_3.Faces, Index=2, Wrap=True)
extr_4 = Extrude(Base=item_4, Direction=X_4)
geo_2 = Geometry([move_5.Geometry, extr_3, extr_4])

sunion = SolidUnion(Breps=flatten([geo, move.Geometry, move_3.Geometry, geo_2]))
sdiff_2 = SolidDifference(BrepsA=sunion, BrepsB=move_4.Geometry)
R = ClusterOutput(sdiff_2)
