# Grasshopper definition parametricSign.gh (Grasshopper 1.0.8)
# Copyright: MIT License vicdlsns / vdl149

font = ValueList({"Sans", "Times New Roman"}, selected="Times New Roman")
text_y_adjust = Slider(0, range=-10..10)
text = Panel("Your text")
text_height = Slider(15, range=12..24)
mode = ValueList({"Surface text": 0, "Hole text": 1}, selected="Hole text")
bold = BooleanToggle(False)
itallic = BooleanToggle(False)

material_thickness = Slider(3, range=1..10)
boxx = Slider(1.5, range=1..2)
filletradius = Slider(2, range=0..2)
boxz = Slider(1.5, range=1..2)

holediameter = Slider(5, range=3..10)
holez = Slider(0, range=-200..200)
holex = Slider(55, range=-200..200)

cluster = Cluster(
    txt=text,
    font=font,
    isbold=bold,
    isitallic=itallic,
    txtheight=text_height,
    txty=text_y_adjust,
    textmode=mode,
    materialthickness=material_thickness,
    boxscalex=boxx,
    boxscalez=boxz,
    filletradius=filletradius,
    holediameter=holediameter,
    holex=holex,
    holez=holez)  # -> S, R
geo = Geometry(cluster.S)
geo_2 = Geometry(cluster.R)

# ==== cluster Cluster
materialthickness = ClusterInput()
boxscalex = ClusterInput()
boxscalez = ClusterInput()
filletradius = ClusterInput()
isitallic = ClusterInput()
txtheight = ClusterInput()
textmode = ClusterInput()
isbold = ClusterInput()
txty = ClusterInput()
font = ClusterInput()
txt = ClusterInput()
holediameter = ClusterInput()
holex = ClusterInput()
holez = ClusterInput()

materialthickness_2 = Number(materialthickness)
boxscalex_2 = Number(boxscalex)
boxscalez_2 = Number(boxscalez)
filletradius_2 = Number(filletradius)

txtheight_2 = Number(txtheight)
textmode_2 = Number(textmode)
isbold_2 = Boolean(isbold)
txty_2 = Number(txty)
font_2 = Text(font)
txt_2 = Text(txt)

holediameter_2 = Number(holediameter)
holex_2 = Number(holex)
holez_2 = Number(holez)

len = TextLength(Text=txt_2)
multiplication = Multiplication(A=txtheight_2, B=len)
X = UnitX(Factor=multiplication)
ln = Line(StartPoint=expr("-x", X), EndPoint=X)

# ----
# Text plane and direction
xz = XZPlane(Origin=Point(0, 0, 0))
rectangle = Rectangle(Plane=xz, XSize=Domain(-1, 1), YSize=Domain(-2, 2), Radius=0)  # -> Rectangle, Length
boundary = BoundarySurfaces(Edges=rectangle.Rectangle)

# ----
# Mounting hole
xz_2 = XZPlane(Origin=Point(0, 0, 0))
division = Division(A=holediameter_2, B=2)
cyl = Cylinder(Base=xz_2, Radius=division, Length=materialthickness_2)
Y = UnitY(Factor=expr("x*0.5", materialthickness_2))
Z = UnitZ(Factor=holez_2)
X_2 = UnitX(Factor=holex_2)
cap = CapHoles(Brep=cyl)
addition = Addition(A=X_2, B=Z, C=Y)
move = Move(Geometry=cap, Motion=addition)  # -> Geometry, Transform

isitallic_2 = Boolean(isitallic)

# ----
# Text object
# Font
py3 = Python3Script(font=font_2, bold=isbold_2, italic=isitallic_2)  # -> out, string; inputs font: String, bold: Boolean, italic: Boolean
# ---------- py3: Python ----------
string = font

if bold:
    string+= " Bold:yes"
else:
    string+= " Bold:no"


if italic:
    string+= " Italic:yes"
else:
    string+= " Italic:no"
# ---------- end py3 ----------
textsrf = TextOnSurface(Text=txt_2, Font=py3.string, Height=txtheight_2, Depth=materialthickness_2, BaseLine=ln, BaseSurface=boundary)

S = ClusterOutput(textsrf)

# ----
# Box construct
bbox = BoundingBox(Content=textsrf, Plane=PlaneXY(0, 0, 0), UnionBox=True)  # -> Box, Box_2
scale_nu = ScaleNU(Geometry=bbox.Box, Plane=PlaneXY(0, 0, 0), ScaleX=boxscalex_2, ScaleY=1, ScaleZ=boxscalez_2)  # -> Geometry, Transform
panel = Panel("""0
1
3
4
5
7
8
9""")
filedge = FilletEdge(Shape=scale_nu.Geometry, Blend=0, Metric=0, Edges=panel, Radii=filletradius_2)

# ----
# Text Y adjust
Y_2 = UnitY(Factor=expr("-x*0.5", materialthickness_2))
Y_3 = UnitY(Factor=txty_2)
addition_2 = Addition(A=Y_2, B=Y_3)
move_2 = Move(Geometry=textsrf, Motion=addition_2)  # -> Geometry, Transform

# ----
# mode - surface text
sunion = SolidUnion(Breps=[move_2.Geometry, filedge])

# ----
# mode - hole text
sdiff = SolidDifference(BrepsA=filedge, BrepsB=move_2.Geometry)

filter = StreamFilter(Gate=textmode_2, Stream0=sunion, Stream1=sdiff)

sdiff_2 = SolidDifference(BrepsA=filter, BrepsB=move.Geometry)

R = ClusterOutput(sdiff_2)
