# Grasshopper definition parametricSpool.gh (Grasshopper 1.0.8)
# Copyright: MIT License vicdlsns / vdl149

# If not needed, set to 0
startendholediameter = Slider(2, range=0..4)
thickness = Slider(3, range=2..5)
borderdiameter = Slider(99, range=50..300)
numberendholes = Slider(15, range=2..20)
height = Slider(60, range=50..300)
# - All units are the same as your Rhino settings
# - Use sliders to set the dimensions as you wish
# - When finished, click on the "geo" component at the end, right-click it, then "Bake" and "Ok"
# Copyright (c) 2025 vicdlsns/vdl149
# MIT License
# https://github.com/vicdlsns
holediameter = Slider(25, range=10..50)
wire_diameter = Panel("1.75")
cluster = Cluster(
    holediameter=holediameter,
    height=height,
    thickness=thickness,
    borderdiameter=borderdiameter,
    startendholediameter=startendholediameter,
    numberendholes=numberendholes,
    wirediameter=wire_diameter)  # -> R, wire_length
approximate_wire_length_the_spool_can_st = Panel(cluster.wire_length)  # "Approximate wire length the spool can store (in rhino units)"
# Middle
geo = Geometry(cluster.R)

# ==== cluster Cluster
startendholediameter = ClusterInput()
numberendholes = ClusterInput()
wirediameter = ClusterInput()
holediameter = ClusterInput()
borderdiameter = ClusterInput()
thickness = ClusterInput()
height = ClusterInput()

startendholediameter_2 = Number(startendholediameter)
numberendholes_2 = Number(numberendholes)

holediameter_2 = Number(holediameter)
borderdiameter_2 = Number(borderdiameter)
thickness_2 = Number(thickness)
height_2 = Number(height)

wirediameter_2 = Number(wirediameter)
division = Division(A=borderdiameter_2, B=2)
division_2 = Division(A=holediameter_2, B=2)
division_3 = Division(A=startendholediameter_2, B=2)

addition = Addition(A=division_2, B=thickness_2)
cyl = Cylinder(Base=PlaneXY(0, 0, 0), Radius=addition, Length=height_2)
cap = CapHoles(Brep=cyl)

# ----
# Borders
cyl_2 = Cylinder(Base=PlaneXY(0, 0, 0), Radius=division, Length=thickness_2)
Z = UnitZ(Factor=height_2)
move = Move(Geometry=cyl_2, Motion=Z)  # -> Geometry, Transform
cap_2 = CapHoles(Brep=move.Geometry)
cap_3 = CapHoles(Brep=cyl_2)

# ----
# Main hole
addition_2 = Addition(A=height_2, B=thickness_2, C=thickness_2)
cyl_3 = Cylinder(Base=PlaneXY(0, 0, 0), Radius=division_2, Length=addition_2)
cap_4 = CapHoles(Brep=cyl_3)

# ----
# Start hole
addition_3 = Addition(A=height_2, B=thickness_2, C=thickness_2)
addition_4 = Addition(A=division_2, B=thickness_2, C=division_3)
cyl_4 = Cylinder(Base=PlaneXY(0, 0, 0), Radius=division_3, Length=addition_3)
cap_5 = CapHoles(Brep=cyl_4)
X = UnitX(Factor=addition_4)
move_2 = Move(Geometry=cap_5, Motion=X)  # -> Geometry, Transform

# ----
# End holes
subtraction = Subtraction(A=division, B=division_3, C=thickness_2)
X_2 = UnitX(Factor=subtraction)
move_3 = Move(Geometry=cap_5, Motion=X_2)  # -> Geometry, Transform
arrpolar = PolarArray(Geometry=move_3.Geometry, Plane=PlaneXY(0, 0, 0), Count=numberendholes_2, Angle=6.283185307)  # -> Geometry, Transform

sunion = SolidUnion(Breps=[cap, cap_3, cap_2])
sdiff = SolidDifference(BrepsA=sunion, BrepsB=cap_4)
sdiff_2 = SolidDifference(BrepsA=sdiff, BrepsB=move_2.Geometry)
sdiff_3 = SolidDifference(BrepsA=sdiff_2, BrepsB=arrpolar.Geometry)

# ----
# Calculate approximate length of
# whatever is being stored
py3_wirelength = Python3Script(Rmin_spool=division_2, Rmax_spool=division, L_spool=height_2, thickness=thickness_2, wire_diameter=wirediameter_2)  # -> out, wire_length; inputs Rmin_spool: Double, Rmax_spool: Double, L_spool: Double, thickness: Double, wire_diameter: Double
# ---------- py3_wirelength: Python ----------
import math

wire_length = 0

v_layers = (Rmax_spool-Rmin_spool-2*thickness)//wire_diameter
h_layers = (L_spool-2*thickness)//wire_diameter

r = Rmin_spool
for i in range(int(v_layers)):
    wire_length+= (h_layers*2*math.pi*r)
    r+=wire_diameter

print(wire_length/1000)
# ---------- end py3_wirelength ----------

wire_length = ClusterOutput(py3_wirelength.wire_length)
R = ClusterOutput(sdiff_3)
